# Dynamo graph CreateSectionBoxFromRoom_script.dyn (Dynamo 2.6.1.8786)
# packages: Genius Loci 2019.6.5, Rhythm 2019.4.25, Data-Shapes 2021.2.91

categories = Categories("OST_Rooms")
links = Links("PLLS-3200-ICN-NI-ARCH-ZZ-ZZ-3DM-1.rvt : 13 : location <Not Shared>")  # graph input
selectbycategory_in_document = Custom[SelectByCategory in Document](category=categories, docOrRevitLinkInstance=links)  # package Genius Loci; Collect elements by category in a linked or open document in the background. The transform CS is returned only with a LinkInstance input.
watch = Watch(selectbycategory_in_document.Element)
string = StringInput("R.+1.81")  # graph input
current = Document.Current()
activeView = Document.ActiveView(document=current)
string_2 = StringInput("Number")
getParameterValueByName = Element.GetParameterValueByName(parameterName=string_2)  # unwired: element
code_block = CodeBlock { "Room Name"; }
code_block_2 = CodeBlock { "Create section box from linked room"; }
string_3 = StringInput("R.+1.81")
textbox_data = Custom[TextBox Data](InputName=code_block_2, DefaultText=string_3)  # package Data-Shapes; Create Data for TextBox input in UI.MultipleInputForm ++ . Check out www.data-shapes.net for more informations
boolean = BoolSelector(true)
multipleinputform = Custom[MultipleInputForm ++](Description_optional=code_block, Inputs=textbox_data, Toggle=boolean)  # package Data-Shapes; Create a form with multiple inputs. see www.data-shapes.net for tutorials and infos!
code_block_3 = CodeBlock(a=multipleinputform.User_Inputs) { a[0]; }
contains = String.Contains(searchFor=code_block_3)  # unwired: str
compose = ComposeFunctions(func0=getParameterValueByName, func1=contains)  # "Function.Compose"
groupByFunction = List.GroupByFunction(list=selectbycategory_in_document.Element, func=compose)
code_block_4 = CodeBlock { 1; }
getItemAtIndex = List.GetItemAtIndex(list=groupByFunction, index=code_block_4)
geometry = Element.Geometry(element=getItemAtIndex)
byGeometry = BoundingBox.ByGeometry(geom=geometry)
ʳʰʸᵗʰᵐ_view3d_setsectionbox = Rhythm.Revit.Views.View3D.SetSectionBox(view3D=activeView, bBox=byGeometry)
minPoint = BoundingBox.MinPoint(boundingBox=byGeometry)  # frozen
convert_point_in_coordinate = Custom[Convert Point in Coordinate Systems](point=minPoint)  # package Genius Loci; Get location point in the 3 coordinate systems : Shared Coordinates, Project Coordinates, Relative Origin Coordinates. Based on a Daniel Woodcock's script.
maxPoint = BoundingBox.MaxPoint(boundingBox=byGeometry)  # frozen
convert_point_in_coordinate_2 = Custom[Convert Point in Coordinate Systems](point=maxPoint)
byCorners = BoundingBox.ByCorners(min=convert_point_in_coordinate.Point_Project_Base_Pt_System, max=convert_point_in_coordinate_2.Point_Project_Base_Pt_System)
textnote_data = Custom[TextNote Data]()  # package Data-Shapes; Create Data for TextNote input in UI.MultipleInputForm ++ . Check out www.data-shapes.net for more informations; unwired: TextNote
dropdown_data = Custom[DropDown Data]()  # package Data-Shapes; Create data for DropDown input in UI.MultiInputForm ++ . Check out www.data-shapes.net for more infos.; unwired: Keys, Values
watch_2 = Watch(multipleinputform.User_Inputs)
